# Grasshopper definition Lava 3D Shape.gh (Grasshopper 1.0.8)

y_divisions = Slider(0.5, range=0.25..10)
x_divisions = Slider(0.5, range=0.25..10)
object_to_slice = Brep(<brep referenced from the Rhino model>)
xz = XZPlane(Origin=Point(0, 0, 0))
yz = YZPlane(Origin=Point(0, 0, 0))
material_cut_thickness = Slider(0.039, range=0..1)
contour = Contour(Shape=object_to_slice, Point=xz, Direction=xz, Distance=y_divisions)
contour_2 = Contour(Shape=object_to_slice, Point=yz, Direction=yz, Distance=x_divisions)
boundary = BoundarySurfaces(Edges=contour)
boundary_2 = BoundarySurfaces(Edges=contour_2)
Y = UnitY(Factor=material_cut_thickness)
X = UnitX(Factor=material_cut_thickness)
flatten = FlattenTree(Tree=boundary, Path="{0}")
graft = GraftTree(Tree=boundary_2, IncludeEmptyLists=True, IncludeNullItems=True)
extr = Extrude(Base=boundary, Direction=Y)
extr_2 = Extrude(Base=boundary_2, Direction=X)
bbx = BrepBrep(BrepA=flatten, BrepB=graft)  # -> Curves, Points
bbox = BoundingBox(Content=object_to_slice, Plane=PlaneXY(0, 0, 0))  # -> Box, Box_2
flatten_2 = FlattenTree(Tree=extr, Path="{0}")
flatten_3 = FlattenTree(Tree=extr_2, Path="{0}")
bbox_2 = BoundingBox(Content=bbx.Curves, Plane=PlaneXY(0, 0, 0))  # -> Box, Box_2
debrep = DeconstructBrep(Brep=bbox.Box)  # -> Faces, Edges, Vertices
box = EvaluateBox(Box=bbox_2.Box, UParameter=0.5, VParameter=0.5, WParameter=0.5)  # -> Plane, Point, Include
pt = Point(box.Point)
item = ListItem(List=debrep.Faces, Index="4", Wrap=True)
item_2 = ListItem(List=debrep.Faces, Index="5", Wrap=True)
project = Project(Geometry=pt, Plane=item_2)  # -> Geometry, Transform
project_2 = Project(Geometry=pt, Plane=item)  # -> Geometry, Transform
dist = Distance(PointA=pt, PointB=project_2.Geometry)
dist_2 = Distance(PointA=pt, PointB=project.Geometry)
multiplication = Multiplication(A=dist_2, B="-1")
box_2 = DomainBox(Base=pt, X=material_cut_thickness, Y=material_cut_thickness, Z=multiplication)
box_3 = DomainBox(Base=pt, X=material_cut_thickness, Y=material_cut_thickness, Z=dist)
flatten_4 = FlattenTree(Tree=box_2, Path="{0}")
flatten_5 = FlattenTree(Tree=box_3, Path="{0}")
sdiff = SolidDifference(BrepsA=flatten_2, BrepsB=flatten_4)
sdiff_2 = SolidDifference(BrepsA=flatten_3, BrepsB=flatten_5)
